# Grasshopper definition newBalloonDragon10_autosave2.gh (Grasshopper 1.0.8)

# This slider represents the material's thickness in mm. You can adjust from 1 to 10.
number_slider = Slider(2, range=1..10)
number = Number(-7.2)
number_2 = Number(-6)
number_3 = Number(-6)
multiplication = Multiplication(A=number, B=number_slider)
multiplication_2 = Multiplication(A=number_slider, B=number_2)
multiplication_3 = Multiplication(A=number_slider, B=number_3)
construct_point = ConstructPoint(XCoordinate=multiplication_2, YCoordinate=90, ZCoordinate=0)
construct_point_2 = ConstructPoint(XCoordinate=multiplication_2, YCoordinate=60, ZCoordinate=0)
construct_point_3 = ConstructPoint(XCoordinate=multiplication_3, YCoordinate=-10, ZCoordinate=0)
construct_point_4 = ConstructPoint(XCoordinate=multiplication_3, YCoordinate=-40, ZCoordinate=0)
construct_point_5 = ConstructPoint(XCoordinate=multiplication, YCoordinate=100, ZCoordinate=0)
construct_point_6 = ConstructPoint(XCoordinate=multiplication, YCoordinate=-50, ZCoordinate=0)
point = Point(Point(-3, -50, 0))
point_2 = Point(Point(50, 25, 0))
point_3 = Point(Point(0, 0, 0))
point_4 = Point(Point(30, 0, 0))
point_5 = Point(Point(30, 50, 0))
point_6 = Point(Point(30, 0, 0))
point_7 = Point(Point(50, 25, 0))
point_8 = Point(Point(30, 50, 0))
point_9 = Point(Point(0, 50, 0))
point_10 = Point(Point(-3, -50, 0))
point_11 = Point(Point(-3, 12, 0))
point_12 = Point(Point(0, 50, 0))
point_13 = Point(Point(0, 38, 0))
point_14 = Point(Point(-3, 12, 0))
point_15 = Point(Point(0, 12, 0))
point_16 = Point(Point(-3, 38, 0))
point_17 = Point(Point(-3, 100, 0))
point_18 = Point(Point(0, 12, 0))
point_19 = Point(Point(0, 0, 0))
point_20 = Point(Point(-6, -40, 0))
point_21 = Point(Point(0, 38, 0))
point_22 = Point(Point(-3, 38, 0))
point_23 = Point(Point(-6, -10, 0))
point_24 = Point(Point(-6, 90, 0))
point_25 = Point(Point(-3, 100, 0))
point_26 = Point(Point(-6, -10, 0))
point_27 = Point(Point(-6, 60, 0))
point_28 = Point(Point(-6, 90, 0))
point_29 = Point(Point(-6, 60, 0))
point_30 = Point(Point(-6, -40, 0))
line = Line(StartPoint=construct_point_2, EndPoint=point_29)
line_2 = Line(StartPoint=point_24, EndPoint=construct_point)
line_3 = Line(StartPoint=construct_point, EndPoint=construct_point_2)
line_4 = Line(StartPoint=point_20, EndPoint=point_23)
line_5 = Line(StartPoint=construct_point_6, EndPoint=point)
line_6 = Line(StartPoint=point_27, EndPoint=point_28)
line_7 = Line(StartPoint=point_26, EndPoint=construct_point_3)
line_8 = Line(StartPoint=construct_point_5, EndPoint=construct_point_6)
line_9 = Line(StartPoint=construct_point_3, EndPoint=construct_point_4)
line_10 = Line(StartPoint=point_7, EndPoint=point_8)
line_11 = Line(StartPoint=point_5, EndPoint=point_9)
line_12 = Line(StartPoint=point_16, EndPoint=point_17)
line_13 = Line(StartPoint=point_4, EndPoint=point_2)
line_14 = Line(StartPoint=point_25, EndPoint=construct_point_5)
line_15 = Line(StartPoint=point_10, EndPoint=point_11)
line_16 = Line(StartPoint=construct_point_4, EndPoint=point_30)
line_17 = Line(StartPoint=point_12, EndPoint=point_13)
line_18 = Line(StartPoint=point_15, EndPoint=point_19)
line_19 = Line(StartPoint=point_3, EndPoint=point_6)
line_20 = Line(StartPoint=point_21, EndPoint=point_22)
line_21 = Line(StartPoint=point_14, EndPoint=point_18)
merge = Merge(
    Data1=line_19,
    Data2=line_13,
    Data3=line_10,
    Data4=line_11,
    Data5=line_17,
    Data6=line_20,
    Data7=line_12,
    Data8=line_14,
    Data9=line_8,
    Data10=line_5,
    Data11=line_15,
    Data12=line_21,
    Data13=line_18,
    Data14=line_2,
    Data15=line_3,
    Data16=line,
    Data17=line_6,
    Data18=line_7,
    Data19=line_9,
    Data20=line_16,
    Data21=line_4)
join_curves = JoinCurves(Curves=merge, Preserve=False)
boundary_surfaces = BoundarySurfaces(Edges=join_curves)
