# Grasshopper definition finalTower.gh (Grasshopper 1.0.8)

# This slider represents the material's thickness in mm. You can adjust from 1 to 10.
number_slider = Slider(2, range=1..10)
number = Number(-12)
number_2 = Number(-9.5)
number_3 = Number(-9.5)
multiplication = Multiplication(A=number, B=number_slider)
multiplication_2 = Multiplication(A=number_slider, B=number_2)
multiplication_3 = Multiplication(A=number_slider, B=number_3)
construct_point = ConstructPoint(XCoordinate=multiplication_3, YCoordinate=-40, ZCoordinate=0)
construct_point_2 = ConstructPoint(XCoordinate=multiplication_3, YCoordinate=-10, ZCoordinate=0)
construct_point_3 = ConstructPoint(XCoordinate=multiplication_2, YCoordinate=90, ZCoordinate=0)
construct_point_4 = ConstructPoint(XCoordinate=multiplication_2, YCoordinate=60, ZCoordinate=0)
construct_point_5 = ConstructPoint(XCoordinate=multiplication, YCoordinate=100, ZCoordinate=0)
construct_point_6 = ConstructPoint(XCoordinate=multiplication, YCoordinate=-50, ZCoordinate=0)
point = Point(Point(-6, -50, 0))
point_2 = Point(Point(50, 25, 0))
point_3 = Point(Point(0, 0, 0))
point_4 = Point(Point(30, 0, 0))
point_5 = Point(Point(30, 50, 0))
point_6 = Point(Point(30, 0, 0))
point_7 = Point(Point(50, 25, 0))
point_8 = Point(Point(30, 50, 0))
point_9 = Point(Point(0, 50, 0))
point_10 = Point(Point(-6, -50, 0))
point_11 = Point(Point(-6, 12, 0))
point_12 = Point(Point(0, 50, 0))
point_13 = Point(Point(0, 38, 0))
point_14 = Point(Point(-6, 12, 0))
point_15 = Point(Point(0, 12, 0))
point_16 = Point(Point(-11, -40, 0))
point_17 = Point(Point(-6, 38, 0))
point_18 = Point(Point(-6, 100, 0))
point_19 = Point(Point(0, 12, 0))
point_20 = Point(Point(0, 0, 0))
point_21 = Point(Point(-11, -10, 0))
point_22 = Point(Point(-11, -10, 0))
point_23 = Point(Point(0, 38, 0))
point_24 = Point(Point(-6, 38, 0))
# You can adjust your pipe, too!
point_25 = Point(Point(-11, -40, 0))
point_26 = Point(Point(-11, 90, 0))
point_27 = Point(Point(-6, 100, 0))
point_28 = Point(Point(-11, 60, 0))
point_29 = Point(Point(-11, 90, 0))
point_30 = Point(Point(-11, 60, 0))
line = Line(StartPoint=construct_point_4, EndPoint=point_30)
line_2 = Line(StartPoint=point_26, EndPoint=construct_point_3)
line_3 = Line(StartPoint=construct_point_3, EndPoint=construct_point_4)
line_4 = Line(StartPoint=point_22, EndPoint=point_25)
line_5 = Line(StartPoint=construct_point_6, EndPoint=point)
line_6 = Line(StartPoint=point_28, EndPoint=point_29)
line_7 = Line(StartPoint=point_16, EndPoint=construct_point)
line_8 = Line(StartPoint=construct_point_5, EndPoint=construct_point_6)
line_9 = Line(StartPoint=construct_point, EndPoint=construct_point_2)
line_10 = Line(StartPoint=point_7, EndPoint=point_8)
line_11 = Line(StartPoint=point_5, EndPoint=point_9)
line_12 = Line(StartPoint=point_17, EndPoint=point_18)
line_13 = Line(StartPoint=point_4, EndPoint=point_2)
line_14 = Line(StartPoint=point_27, EndPoint=construct_point_5)
line_15 = Line(StartPoint=point_10, EndPoint=point_11)
line_16 = Line(StartPoint=construct_point_2, EndPoint=point_21)
line_17 = Line(StartPoint=point_12, EndPoint=point_13)
line_18 = Line(StartPoint=point_15, EndPoint=point_20)
line_19 = Line(StartPoint=point_3, EndPoint=point_6)
line_20 = Line(StartPoint=point_23, EndPoint=point_24)
line_21 = Line(StartPoint=point_14, EndPoint=point_19)
merge = Merge(
    Data1=line_19,
    Data2=line_13,
    Data3=line_10,
    Data4=line_11,
    Data5=line_17,
    Data6=line_20,
    Data7=line_12,
    Data8=line_14,
    Data9=line_8,
    Data10=line_5,
    Data11=line_15,
    Data12=line_21,
    Data13=line_18,
    Data14=line_2,
    Data15=line_3,
    Data16=line,
    Data17=line_6,
    Data18=line_7,
    Data19=line_9,
    Data20=line_16,
    Data21=line_4)
rectangle = Rectangle(Plane=PlaneXY(0, 0, 0), XSize=Domain(0, 50), YSize=Domain(0, 50), Radius=0)  # -> Rectangle, Length
curve = Curve(<curve referenced from the Rhino model>)
scale = Scale(Geometry=curve, Center=Point(0, 0, 0), Factor=Slider(2, range=0..10))  # -> Geometry, Transform
merge_2 = Merge(
    Data1=Slider(18, range=0..20),
    Data2=Slider(18, range=0..20),
    Data3=Slider(18, range=0..20),
    Data4=Slider(18, range=0..20),
    Data5=Slider(18, range=0..20),
    Data6=Slider(18, range=0..20),
    Data7=Slider(18, range=0..20),
    Data8=Slider(18, range=0..21))
merge_3 = Merge(
    Data1=Slider(0, range=0..75),
    Data2=Slider(15, range=0..75),
    Data3=Slider(21, range=0..75),
    Data4=Slider(42, range=0..75),
    Data5=Slider(51, range=0..75),
    Data6=Slider(57, range=0..75),
    Data7=Slider(62, range=0..75),
    Data8=Slider(76.219, range=0..77))
box_rectangle = BoxRectangle(Rectangle=rectangle.Rectangle, Height=Slider(2.88, range=0..5))
join_curves = JoinCurves(Curves=merge, Preserve=False)
# Adjust these above for more or less segments
number_slider_2 = Slider(7, range=0..10)
pipe_variable = PipeVariable(Curve=scale.Geometry, Parameters=merge_3, Radii=merge_2, Caps=0)
boundary_surfaces = BoundarySurfaces(Edges=join_curves)
divide_domain² = DivideDomain²(Domain=pipe_variable, UCount=Slider(6, range=0..30), VCount=number_slider_2)
surface_box = SurfaceBox(Surface=pipe_variable, Domain=divide_domain², Height=Slider(0.99, range=0..10))
box_morph = BoxMorph(Geometry=boundary_surfaces, Reference=box_rectangle, Target=surface_box)
